# Grasshopper definition HFC T1 Tower Whole System.gh (Grasshopper 1.0.7)
# plug-ins: Human, LunchBox, Palette

# ---- group: 1
最大轮廓层半径 = Slider(30.5, range=0..100)
首层内接圆半径 = Slider(25.8, range=0..100)
number_slider = Slider(-56.1, range=-100..356)
number_slider_2 = Slider(56.1, range=-100..356)
number_slider_3 = Slider(204.6, range=-100..356)
number_slider_4 = Slider(0, range=-100..356)
number_slider_5 = Slider(120.6, range=-100..356)
number_slider_6 = Slider(311.1, range=-100..356)

# ---- group: 3
# 常规楼层数据设置
# 层数-层高-功能
panel = Panel("1-37.5-roof garden ")
panel_2 = Panel("1-5.0-Commercial")
panel_3 = Panel("3-5.4-Commercial")
panel_4 = Panel("53-4.5-Office")
panel_5 = Panel("1-4.5-Rescue platform")

# 避难设备层数据设置
# 楼层位置-层高-功能
panel_6 = Panel("21-6-Refuge")
panel_7 = Panel("31-4.5-Mep")
panel_8 = Panel("32-6-Refuge")
panel_9 = Panel("43-6-Refuge")
panel_10 = Panel("10-6-Refuge")
panel_11 = Panel("54-6-Refuge")
panel_12 = Panel("65-2.1-structural")
panel_13 = Panel("66-6-Refuge")

# ---- group: 3 / 核心筒
brep = Brep(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)

# ---- group: 3 / 初始楼层高度
panel_14 = Panel("0")

# ---- group: 1 / 塔冠
brep_2 = Brep([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])

# ---- group: 4
number_slider_7 = Slider(482.8, range=0..1000)
number_slider_8 = Slider(273.7, range=0..1000)

number_slider_9 = Slider(317.42, range=0..1000)
number_slider_10 = Slider(648.78, range=0..1000)

# ---- group: 5
division = Division(A="500", B=1000)
division_2 = Division(A="500", B=1000)
multiplication = Multiplication(A=Slider(210, range=0..1000), B=division_2)
multiplication_2 = Multiplication(A=Slider(297, range=0..1000), B=division)
division_3 = Division(A=multiplication_2, B=2)
division_4 = Division(A=multiplication, B=2)
neg = Negative(Value=division_3)
neg_2 = Negative(Value=division_4)
pt = ConstructPoint(XCoordinate=0, YCoordinate=0, ZCoordinate=0)
dom = ConstructDomain(DomainStart=neg, DomainEnd=division_3)
dom_2 = ConstructDomain(DomainStart=neg_2, DomainEnd=division_4)
rectangle = Rectangle(Plane=pt, XSize=dom, YSize=dom_2, Radius=0)  # -> Rectangle, Length

# ----
swatch = ColourSwatch(SwatchColor=RGB(204, 204, 204))
swatch_2 = ColourSwatch(SwatchColor=RGB(98, 160, 204))
swatch_3 = ColourSwatch(SwatchColor=RGB(115, 115, 115))
swatch_4 = ColourSwatch(SwatchColor=RGB(255, 255, 255))

panel_15 = Panel("""1
2
3
4
5""")
merge = Merge(
    Data1=ColourSwatch(SwatchColor=RGB(242, 237, 255)),
    Data2=ColourSwatch(SwatchColor=RGB(217, 235, 255)),
    Data3=ColourSwatch(SwatchColor=RGB(207, 255, 250)),
    Data4=ColourSwatch(SwatchColor=RGB(255, 250, 207)),
    Data5=ColourSwatch(SwatchColor=RGB(255, 214, 207)))
group_color = SliderGroupColor(run=Button(), groupNames=panel_15, colors=merge, defaultColor=ColourSwatch(SwatchColor=RGB(235, 235, 235)))  # inputs run: Boolean, groupNames: list of String, colors: list of Color, defaultColor: Color
# ---------- group_color: C# usings ----------
using System.Drawing;
using Grasshopper.Kernel.Special;
# ---------- group_color: C# ----------
    // Created by Timo Harboe Nielsen - Bjarke Ingels Group.
    
    if(!run){
      return;
    }
    GH_Document doc = owner.OnPingDocument();
    foreach (var dobj in doc.Objects)
    {
      GH_Group _group = dobj as GH_Group;
      if( _group == null){
        continue;
      }
      for(int i = 0; i < Math.Min(groupNames.Count, colors.Count); i++){
        string groupName = _group.NickName.ToString();
        string compareName = groupNames[i];
        if(groupName.IndexOf(compareName, StringComparison.OrdinalIgnoreCase) >= 0){
          _group.Colour = colors[i];
          break;
        } else{
          _group.Colour = defaultColor;
        }
      }
    }
# ---------- end group_color ----------

palette = Palette(
    ModeCustomStandard=Toggle(True),
    Component_Normal_Deselected_Fill_Color=swatch,
    Component_Normal_Deselected_Edge_Color=RGB(50, 50, 50),
    Component_Normal_Deselected_Text_Color=RGB(0, 0, 0),
    Component_Normal_Selected_Fill_Color=RGB(130, 215, 50),
    Component_Normal_Selected_Edge_Color=RGB(0, 50, 0),
    Component_Normal_Selected_Text_Color=RGB(0, 25, 0),
    Component_Hidden_Deselected_Fill_Color=swatch,
    Component_Hidden_Deselected_Edge_Color=RGB(35, 35, 35),
    Component_Hidden_Deselected_Text_Color=RGB(0, 0, 0),
    Component_Hidden_Selected_Fill_Color=RGB(80, 180, 10),
    Component_Hidden_Selected_Edge_Color=RGB(0, 35, 0),
    Component_Hidden_Selected_Text_Color=RGB(0, 25, 0),
    Component_Disabled_Deselected_Fill_Color=swatch,
    Component_Disabled_Deselected_Edge_Color=RGB(90, 90, 90),
    Component_Disabled_Deselected_Text_Color=RGB(70, 70, 70),
    Component_Disabled_Selected_Fill_Color=RGB(110, 150, 115),
    Component_Disabled_Selected_Edge_Color=RGB(40, 70, 40),
    Component_Disabled_Selected_Text_Color=RGB(75, 100, 65),
    Component_Warning_Deselected_Fill_Color=swatch,
    Component_Warning_Deselected_Edge_Color=RGB(80, 10, 0),
    Component_Warning_Deselected_Text_Color=RGB(0, 0, 0),
    Component_Warning_Selected_Fill_Color=RGB(185, 205, 0),
    Component_Warning_Selected_Edge_Color=RGB(0, 50, 0),
    Component_Warning_Selected_Text_Color=RGB(0, 0, 0),
    Component_Error_Deselected_Fill_Color=swatch,
    Component_Error_Deselected_Edge_Color=RGB(60, 0, 0),
    Component_Error_Deselected_Text_Color=RGB(0, 0, 0),
    Component_Error_Selected_Fill_Color=RGB(125, 155, 0),
    Component_Error_Selected_Edge_Color=RGB(0, 50, 0),
    Component_Error_Selected_Text_Color=RGB(255, 255, 255),
    Component_Label_Deselected_Fill_Color=swatch,
    Component_Label_Deselected_Edge_Color=RGB(0, 0, 0),
    Component_Label_Deselected_Text_Color=RGB(255, 255, 255),
    Component_Label_Selected_Fill_Color=RGB(25, 60, 25),
    Component_Label_Selected_Edge_Color=RGB(0, 35, 0),
    Component_Label_Selected_Text_Color=RGB(190, 250, 180),
    Galapagos_Deselected_Fill_Color=RGB(255, 0, 125),
    Galapagos_Deselected_Edge_Color=RGB(100, 0, 50),
    Galapagos_Selected_Fill_Color=RGB(160, 210, 30),
    Galapagos_Selected_Edge_Color=RGB(0, 50, 0),
    Wire_Normal_Color=swatch_2,
    Wire_Empty_Color=swatch_2,
    Wire_Selected_Start_Color=swatch_2,
    Wire_Selected_End_Color=swatch_2,
    Panel_Default_Color=swatch_3,
    Group_Default_Color=swatch_3,
    Canvas_Background_Color=swatch_4,
    Canvas_Gridline_Color=swatch_4,
    Canvas_Gridline_Width=150,
    Canvas_Gridline_Height=50,
    Canvas_Edge_Color=RGB(0, 0, 0),
    Canvas_Shadow_Color=RGBA(0, 0, 0, 80),
    Canvas_Shadow_Size=30,
    MonochromaticOnOff=False,
    Monochromatic_Color=RGB(212, 208, 200))

# ---- group: 1
# 1.关键变化层轮廓
# 高度和大小
pt_2 = Point(Point(0, 0, 0))
merge_2 = Merge(
    Data1=number_slider,
    Data2=number_slider_4,
    Data3=number_slider_2,
    Data4=number_slider_5,
    Data5=number_slider_3,
    Data6=number_slider_6)
panel_16 = Panel("30")
cos = Cosine(Value=degrees(panel_16))
multiplication_3 = Multiplication(A=首层内接圆半径, B=cos)
pdecon = Deconstruct(Point=pt_2)  # -> XComponent, YComponent, ZComponent
pt_3 = ConstructPoint(XCoordinate=pdecon.XComponent, YCoordinate=pdecon.YComponent, ZCoordinate=merge_2)
xy = XYPlane(Origin=pt_3)
panel_17 = Panel("""0
30
0
30
0
0""")
neg_3 = Negative(Value=panel_17)

cos_2 = Cosine(Value=degrees(panel_16))
cos_3 = Cosine(Value=degrees(panel_16))
multiplication_4 = Multiplication(A=最大轮廓层半径, B=cos_2)
multiplication_5 = Multiplication(A=首层内接圆半径, B=cos_3)

item = ListItem(List=merge_2, Index=0, Wrap=True)  # -> Item, Item1, Item2
item_2 = ListItem(List=merge_2, Index=0, Wrap=True)  # -> Item, Item1, Item2
subtraction = Subtraction(A=multiplication_4, B=multiplication_3)
subtraction_2 = Subtraction(A=item_2.Item1, B=item_2.Item)
subtraction_3 = Subtraction(A=item.Item2, B=item.Item1)
division_5 = Division(A=subtraction, B=subtraction_3)
multiplication_6 = Multiplication(A=division_5, B=subtraction_2)
subtraction_4 = Subtraction(A=multiplication_3, B=multiplication_6)

merge_3 = Merge(
    Data1=subtraction_4,
    Data2=首层内接圆半径,
    Data3=multiplication_4,
    Data4=最大轮廓层半径,
    Data5=multiplication_4,
    Data6=multiplication_5)
circle = Circle(Plane=pt_3, Radius=merge_3)

# ---- group: 3
# 6.功能平面优化调整系统
panel_18 = Panel("1-5.7-empty space ")
merge_4 = Merge(Data1=panel_2, Data2=panel_3, Data3=panel_18, Data4=panel_4, Data5=panel, Data6="1-4.5-mep ", Data7=panel_5)
merge_5 = Merge(
    Data1=panel_10,
    Data2=panel_6,
    Data3=panel_7,
    Data4=panel_8,
    Data5=panel_9,
    Data6=panel_11,
    Data7=panel_12,
    Data8=panel_13)
swatch_5 = ColourSwatch(SwatchColor=RGB(98, 203, 245))
merge_6 = Merge(
    Data1=ColourSwatch(SwatchColor=RGB(255, 128, 128)),
    Data2=ColourSwatch(SwatchColor=RGB(255, 191, 128)),
    Data3=ColourSwatch(SwatchColor=RGB(255, 255, 128)),
    Data4=ColourSwatch(SwatchColor=RGB(191, 255, 128)),
    Data5=ColourSwatch(SwatchColor=RGB(128, 255, 128)),
    Data6=ColourSwatch(SwatchColor=RGB(128, 255, 191)),
    Data7=ColourSwatch(SwatchColor=RGB(128, 255, 255)))
split = TextSplit(Text=merge_5, Separators="-")  # -> simplify(Result)
lng = ListLength(List=merge_4)  # -> expr("x-1", Length)
item_3 = ListItem(List=split, Index=0, Wrap=True)  # -> flatten(Item), flatten(Item1), flatten(Item2)
split_2 = TextSplit(Text=merge_4, Separators="-")  # -> simplify(Result)

# ---- group: 3 / 避难设备层颜色
col = Colour(swatch_5)

# ---- group: 3 / 主功能楼层颜色
col_2 = Colour(merge_6)

# ---- group: 3
lng_2 = ListLength(List=item_3.Item)
series = Series(Start=0, Step=1, Count=lng_2)
subtraction_5 = Subtraction(A=item_3.Item, B=series)
subtraction_6 = Subtraction(A=subtraction_5, B="1")

subset = SubList(List=col_2, Domain=lng, Wrap=True)  # -> simplify(graft(List)), Index
merge_7 = Merge(Data1=split_2, Data2=subset.List)
item_4 = ListItem(List=merge_7, Index=0, Wrap=True)  # -> Item, Item1, Item2, Item3
repeat = RepeatData(Data=item_4.Item2, Length=item_4.Item)
repeat_2 = RepeatData(Data=item_4.Item3, Length=item_4.Item)
repeat_3 = RepeatData(Data=item_4.Item1, Length=item_4.Item)
flatten = FlattenTree(Tree=repeat_3, Path="{0}")
flatten_2 = FlattenTree(Tree=repeat, Path="{0}")
flatten_3 = FlattenTree(Tree=repeat_2, Path="{0}")

ins = InsertItems(List=flatten_2, Item=item_3.Item2, Indices=subtraction_6, Wrap=True)
ins_2 = InsertItems(List=flatten, Item=item_3.Item1, Indices=subtraction_6, Wrap=True)
ins_3 = InsertItems(List=flatten_3, Item=col, Indices=subtraction_6, Wrap=True)
ins_4 = InsertItems(List=flatten, Item=item_3.Item1, Indices=subtraction_6, Wrap=True)

# ---- group: 4
lng_3 = ListLength(List=ins_4)
series_2 = Series(Start=1, Step=1, Count=lng_3)
concat = Concatenate(FragmentA=series_2, FragmentB="F")

# ---- group: 1
prot = RotatePlane(Plane=xy, Angle=degrees(panel_17))
polygon = Polygon(Plane=prot, Radius=merge_3, Segments=6, FilletRadius=0)  # -> Polygon, Length
disc = Discontinuity(Curve=polygon.Polygon, Level=1)  # -> Points, Parameters
flip = FlipMatrix(Data=disc.Points)
pline = PolyLine(Vertices=flip, Closed=False)
explode = Explode(Curve=pline, Recursive=True)  # -> Segments, Vertices
disc_2 = Discontinuity(Curve=pline, Level=1)  # -> Points, Parameters
eval = EvaluateCurve(Curve=reparameterize(explode.Segments), Parameter=Slider(0.5, range=0..1))  # -> Point, Tangent, Angle

flip_2 = FlipMatrix(Data=eval.Point)
item_5 = ListItem(List=polygon.Polygon, Index="4", Wrap=True)
pline_2 = PolyLine(Vertices=flip_2, Closed=True)  # -> flatten(Polyline)
bang = ExplodeTree(Data=flip_2)  # -> Branch0, Branch1, Branch2, Branch3, Branch4
item_6 = ListItem(List=pline_2, Index=-1, Wrap=True)
pcen = PolygonCenter(Polyline=item_5)  # -> CenterV, CenterE, CenterA
pcen_2 = PolygonCenter(Polyline=item_6)  # -> CenterV, CenterE, CenterA
vec2pt = Vector2Pt(PointA=pcen.CenterV, PointB=pcen_2.CenterV, Unitize=False)  # -> Vector, Length
move = Move(Geometry=item_5, Motion=vec2pt.Vector)  # -> Geometry, Transform
disc_3 = Discontinuity(Curve=move.Geometry, Level=1)  # -> Points, Parameters
disc_4 = Discontinuity(Curve=item_6, Level=1)  # -> Points, Parameters
ln = Line(StartPoint=disc_4.Points, EndPoint=disc_3.Points)
curvepoint = PointOnCurve(ln, parameter=1)
entwine = Entwine(
    Branch00=bang.Branch0,
    Branch01=bang.Branch1,
    Branch02=bang.Branch2,
    Branch03=bang.Branch3,
    Branch04=curvepoint,
    FlattenInputs=True)
flip_3 = FlipMatrix(Data=entwine)

# 2.关键变化层轮廓
cull_i = CullIndex(List=polygon.Polygon, Indices=0, Wrap=True)
group = Group(Objects=cull_i)
xy_2 = XYPlane(Origin=pt_2)

weave = Weave(Pattern=[0, 1], Stream0=simplify(disc_2.Points), Stream1=simplify(flip_3), NullGaps=False)
nurbs = NurbsCurve(Vertices=weave, Degree=3, Periodic=False)  # -> flatten(Curve), Length, Domain
crv = Curve(nurbs.Curve)
pcx = CurvePlane(Curve=reparameterize(crv), Plane=xy_2)  # -> Points, ParamsC, ParamsP
shatter = Shatter(Curve=reparameterize(graft(crv)), Parameters=pcx.ParamsC)
item_7 = ListItem(List=shatter, Index=1, Wrap=True)
crv_2 = Curve(flatten(item_7))

prot_2 = RotatePlane(Plane=xy, Angle=degrees(neg_3))
polygon_2 = Polygon(Plane=prot_2, Radius=merge_3, Segments=6, FilletRadius=0)  # -> Polygon, Length
disc_5 = Discontinuity(Curve=polygon_2.Polygon, Level=1)  # -> Points, Parameters
flip_4 = FlipMatrix(Data=disc_5.Points)
pline_3 = PolyLine(Vertices=flip_4, Closed=False)
explode_2 = Explode(Curve=pline_3, Recursive=True)  # -> Segments, Vertices
disc_6 = Discontinuity(Curve=pline_3, Level=1)  # -> Points, Parameters
eval_2 = EvaluateCurve(Curve=reparameterize(explode_2.Segments), Parameter=Slider(0.5, range=0..1))  # -> Point, Tangent, Angle

flip_5 = FlipMatrix(Data=eval_2.Point)
item_8 = ListItem(List=polygon_2.Polygon, Index="4", Wrap=True)
pline_4 = PolyLine(Vertices=flip_5, Closed=True)  # -> flatten(Polyline)
bang_2 = ExplodeTree(Data=flip_5)  # -> Branch0, Branch1, Branch2, Branch3, Branch4
item_9 = ListItem(List=pline_4, Index=-1, Wrap=True)
pcen_3 = PolygonCenter(Polyline=item_8)  # -> CenterV, CenterE, CenterA
pcen_4 = PolygonCenter(Polyline=item_9)  # -> CenterV, CenterE, CenterA
vec2pt_2 = Vector2Pt(PointA=pcen_3.CenterV, PointB=pcen_4.CenterV, Unitize=False)  # -> Vector, Length
move_2 = Move(Geometry=item_8, Motion=vec2pt_2.Vector)  # -> Geometry, Transform
disc_7 = Discontinuity(Curve=move_2.Geometry, Level=1)  # -> Points, Parameters
disc_8 = Discontinuity(Curve=item_9, Level=1)  # -> Points, Parameters
ln_2 = Line(StartPoint=disc_8.Points, EndPoint=disc_7.Points)
curvepoint_2 = PointOnCurve(ln_2, parameter=1)
entwine_2 = Entwine(
    Branch00=bang_2.Branch0,
    Branch01=bang_2.Branch1,
    Branch02=bang_2.Branch2,
    Branch03=bang_2.Branch3,
    Branch04=curvepoint_2,
    FlattenInputs=True)
flip_6 = FlipMatrix(Data=entwine_2)

weave_2 = Weave(Pattern=[0, 1], Stream0=simplify(disc_6.Points), Stream1=simplify(flip_6), NullGaps=False)
nurbs_2 = NurbsCurve(Vertices=weave_2, Degree=3, Periodic=False)  # -> flatten(Curve), Length, Domain
crv_3 = Curve(nurbs_2.Curve)
pcx_2 = CurvePlane(Curve=reparameterize(crv_3), Plane=xy_2)  # -> Points, ParamsC, ParamsP
shatter_2 = Shatter(Curve=reparameterize(graft(crv_3)), Parameters=pcx_2.ParamsC)
item_10 = ListItem(List=shatter_2, Index=1, Wrap=True)
crv_4 = Curve(flatten(item_10))

# 3.主塔体量轮廓
panel_19 = Panel("1")
shift = ShiftList(List=crv_4, Shift=panel_19, Wrap=True)
merge_8 = Merge(Data1=simplify(graft(crv_2)), Data2=simplify(graft(crv_4)))
merge_9 = Merge(Data1=simplify(graft(crv_2)), Data2=simplify(graft(shift)))
loft = Loft(Curves=merge_8, Options={Adjust=False, Closed=False, LoftEnds=0, LoftSimp=0, LoftType=0, Rebuild=10, Refit=0.01})  # -> flatten(Loft)
loft_2 = Loft(Curves=merge_9, Options={Adjust=False, Closed=False, LoftEnds=0, LoftSimp=0, LoftType=0, Rebuild=10, Refit=0.01})  # -> flatten(Loft)
flip_7 = Flip(Surface=loft)  # -> flatten(Surface), Result
merge_10 = Merge(Data1=flip_7.Surface, Data2=loft_2)

# ---- group: 1 / 塔身
join = BrepJoin(Breps=merge_10)  # -> Breps, Closed

# ---- group: 3 / 塔楼轮廓
brep_3 = Brep(join.Breps)

# ---- group: 3 (continued)
ins_5 = InsertItems(List=ins_4, Item=panel_14, Indices="0", Wrap=True)
ins_6 = InsertItems(List=ins_4, Item=panel_14, Indices="0", Wrap=True)
cull_i_2 = CullIndex(List=ins_6, Indices=-1, Wrap=True)
contour = ContourEx(Shape=brep_3, Plane=PlaneXY(0, 0, 0), Distances=cull_i_2)
contour_2 = ContourEx(Shape=brep, Plane=PlaneXY(0, 0, 0), Distances=cull_i_2)

curve = Curve(contour)  # disabled
explode_3 = Explode(Curve=curve, Recursive=True)  # -> Segments, Vertices; disabled
number_slider_11 = Slider(1, range=0..100)  # disabled
number_slider_12 = Slider(5, range=0..100)  # disabled
length = Length(Curve=explode_3.Segments)  # -> simplify(Length); disabled
list_item = ListItem(List=length, Index=number_slider_11, Wrap=True)  # disabled
list_item_2 = ListItem(List=length, Index=number_slider_12, Wrap=True)  # disabled
param_viewer = ParamViewer(length)  # disabled
subtraction_7 = Subtraction(A=list_item, B=list_item_2)  # disabled
panel_20 = Panel(subtraction_7)  # disabled
equality = Equality()  # -> Equality, Inequality; disabled

# ---- group: 3 / 核心筒轮廓
crv_5 = Curve(flatten(contour_2))

# ---- group: 3 / 楼层轮廓
crv_6 = Curve(flatten(contour))

# ---- group: 3 (continued)
boundary = BoundarySurfaces(Edges=crv_6)
preview = CustomPreview(Geometry=boundary, Material=ins_3)

# ---- group: 4
ma = MassAddition(Input=ins_5)  # -> Result, PartialResults
flatten_4 = FlattenTree(Tree=contour, Path="{0}")
area = Area(Geometry=flatten_4)  # -> Area, Centroid
cull_i_3 = CullIndex(List=ma.PartialResults, Indices="-1", Wrap=True)
concat_2 = Concatenate(FragmentA=ins_4, FragmentB="M")
concat_3 = Concatenate(FragmentA=cull_i_3, FragmentB="M")
panel_21 = Panel(concat)
panel_22 = Panel(ins)
panel_23 = Panel(concat_2)
panel_24 = Panel(concat_3)
panel_25 = Panel(area.Area)
panel_26 = Panel(ins_3)

split_3 = SplitList(List=area.Area, Index="54")  # -> ListA, ListB
subtraction_8 = Subtraction(A=split_3.ListB, B=number_slider_8)
subtraction_9 = Subtraction(A=split_3.ListA, B=number_slider_7)
merge_11 = Merge(Data1=subtraction_9, Data2=subtraction_8)
division_6 = Division(A=merge_11, B=area.Area)
bnd = Bounds(Numbers=division_6)
dedomain = DeconstructDomain(Domain=bnd)  # -> Start, End

# ---- group: 1 / 楼层轮廓
crv_7 = Curve(flatten(crv_6))  # disabled

# ---- group: 1
# 4.各楼层平面轮廓
panel_27 = Panel("0.001")  # disabled
fillet = Fillet(Curve=crv_7, Radius=panel_27)  # disabled
panel_28 = Panel("-0.5")  # disabled
offset = OffsetCurve(Curve=fillet, Distance=panel_28, Plane=PlaneXY(0, 0, 0), Corners=1)  # disabled
number_slider_13 = Slider(32, range=0..100)  # disabled
area_2 = Area(Geometry=offset)  # -> Area, Centroid; disabled
number_slider_14 = Slider(32, range=0..100)  # disabled
X = UnitX(Factor=number_slider_13)  # disabled
Y = UnitY(Factor=number_slider_14)  # disabled
neg_4 = Negative(Value=X)  # disabled
neg_5 = Negative(Value=Y)  # disabled
move_3 = Move(Geometry=area_2.Centroid, Motion=X)  # -> Geometry, Transform; disabled
move_4 = Move(Geometry=area_2.Centroid, Motion=neg_4)  # -> Geometry, Transform; disabled
move_5 = Move(Geometry=area_2.Centroid, Motion=Y)  # -> Geometry, Transform; disabled
move_6 = Move(Geometry=area_2.Centroid, Motion=neg_5)  # -> Geometry, Transform; disabled
ln_3 = Line(StartPoint=move_4.Geometry, EndPoint=move_3.Geometry)  # disabled
ln_4 = Line(StartPoint=move_6.Geometry, EndPoint=move_5.Geometry)  # disabled

# ---- group: 4
# 7.一键数据指标生成系统
number_slider_15 = Slider(4, range=0..10)
concat_4 = Concatenate()
四舍五入 = 四舍五入(A=panel_25, x="2")
series_3 = Series(Start=0, Step=1, Count=number_slider_15)
cull_i_4 = CullIndex(List=panel_25, Indices=series_3, Wrap=True)
X_2 = UnitX(Factor=1)
number_slider_16 = Slider(3, range=0..10)
pt_4 = Point(area.Centroid)
ma_2 = MassAddition(Input=cull_i_4)  # -> Result, PartialResults
panel_29 = Panel(ma_2.Result)
gradient = Gradient(
    LowerLimit=dedomain.Start,
    UpperLimit=dedomain.End,
    Parameter=division_6,
    stops=[0: RGB(255, 255, 255), 1: RGB(115, 115, 115)])
multiplication_7 = Multiplication(A=division_6, B=100)
四舍五入_2 = 四舍五入(A=multiplication_7, x="2")
concat_5 = Concatenate(FragmentA=四舍五入_2, FragmentB="%")
panel_30 = Panel("""楼层
功能
层高
标高
面积""")
excelwrite = ExcelWriteLEGACY(
    WriteToggle=Toggle(False),
    WriteHeading=Toggle(True),
    ClearSheet=False,
    Worksheet=Slider(2, range=0..10),
    ColumnStart=1,
    RowStart=1,
    ColumnHeadings=panel_30,
    Column1=panel_21,
    Column2=panel_22,
    Column3=panel_23,
    Column4=panel_24,
    Column5=四舍五入)

line = LineSDL(Start=pt_4, Direction=X_2, Length=Slider(60, range=0..100))
end = EndPoints(Curve=line)  # -> Start, End
xz = XZPlane(Origin=end.End)
tag = TextTag3D(Location=xz, Text=panel_22, Size=number_slider_16, Colour=panel_26, Justification=7)

line_2 = LineSDL(Start=pt_4, Direction=X_2, Length=Slider(125, range=0..200))
end_2 = EndPoints(Curve=line_2)  # -> Start, End
xz_2 = XZPlane(Origin=end_2.End)
tag_2 = TextTag3D(Location=xz_2, Text=四舍五入, Size=number_slider_16, Colour=panel_26, Justification=7)

line_3 = LineSDL(Start=pt_4, Direction=X_2, Length=Slider(50, range=0..100))
end_3 = EndPoints(Curve=line_3)  # -> Start, End
xz_3 = XZPlane(Origin=end_3.End)
tag_3 = TextTag3D(Location=xz_3, Text=panel_21, Size=number_slider_16, Colour=panel_26, Justification=7)

line_4 = LineSDL(Start=pt_4, Direction=X_2, Length=Slider(90, range=0..100))
end_4 = EndPoints(Curve=line_4)  # -> Start, End
xz_4 = XZPlane(Origin=end_4.End)
tag_4 = TextTag3D(Location=xz_4, Text=panel_23, Size=number_slider_16, Colour=panel_26, Justification=7)

line_5 = LineSDL(Start=pt_4, Direction=X_2, Length=Slider(105, range=0..200))
end_5 = EndPoints(Curve=line_5)  # -> Start, End
xz_5 = XZPlane(Origin=end_5.End)
tag_5 = TextTag3D(Location=xz_5, Text=panel_24, Size=number_slider_16, Colour=panel_26, Justification=7)

line_6 = LineSDL(Start=pt_4, Direction=X_2, Length=Slider(146, range=0..200))
end_6 = EndPoints(Curve=line_6)  # -> Start, End
xz_6 = XZPlane(Origin=end_6.End)
tag_6 = TextTag3D(Location=xz_6, Text=concat_5, Size=number_slider_16, Colour=gradient, Justification=7)

# ---- group: 1 / 边梁定位线
crv_8 = Curve(simplify(offset))  # disabled

# ---- group: 1 / A轴
crv_9 = Curve(ln_3)  # disabled

# ---- group: 1 / 1轴
crv_10 = Curve(ln_4)  # disabled

# ---- group: 5 / 边梁定位线
crv_11 = Curve(simplify(crv_8))

# ---- group: 5
number_slider_17 = Slider(8, range=0..50)
lng_4 = ListLength(List=area.Centroid)
integer_division = IntegerDivision(A=lng_4, B=number_slider_17)
addition = Addition(A=integer_division, B=1)
pt_5 = ConstructPoint(XCoordinate=0, YCoordinate=0, ZCoordinate=0)
arrrec = RectangularArray(Geometry=pt_5, Cell=rectangle.Rectangle, XCount=number_slider_17, YCount=expr("-x", addition))  # -> simplify(graft(Geometry)), Transform

# 8.一键出图系统
short = ShortestList(ListA=flatten(area.Centroid), ListB=flatten(arrrec.Geometry), TrimMode=2)  # -> graft(ListA), graft(ListB)
pt_6 = Point(short.ListB)

pt_7 = ConstructPoint(XCoordinate=Slider(64, range=0..100), YCoordinate=Slider(43, range=0..100), ZCoordinate=0)
lng_5 = ListLength(List=flatten(pt_6))
neg_6 = Negative(Value=pt_7)
series_4 = Series(Start=0, Step=1, Count=lng_5)
addition_2 = Addition(A=pt_6, B=neg_6)
addition_3 = Addition(A=series_4, B="1")
tag_7 = TextTag3D(Location=flatten(addition_2), Text=addition_3, Size=Slider(12, range=0..100), Justification=7)

# ---- group: 2
# 5.定位轴线
# 6.巨柱和小柱
# 中心定位线
# 当巨柱间的跨度
# 小于9M时增加小柱
disc_9 = Discontinuity(Curve=crv_8, Level=1)  # -> simplify(Points), Parameters; disabled

panel_31 = Panel("6")  # disabled
tstat = TreeStatistics(Tree=disc_9.Points)  # -> Paths, Length, Count; disabled
larger = LargerThan(FirstNumber=tstat.Length, SecondNumber=panel_31)  # -> LargerThan, OrEqualTo; disabled
dispatch = Dispatch(List=tstat.Paths, DispatchPattern=larger.LargerThan)  # -> ListA, ListB; disabled
branch = TreeBranch(Tree=disc_9.Points, Path=dispatch.ListA, MaintainPaths=True)  # disabled
branch_2 = TreeBranch(Tree=disc_9.Points, Path=dispatch.ListB, MaintainPaths=True)  # disabled
panel_32 = Panel("2")  # disabled
dup = DuplicateData(Data=branch_2, Number=panel_32, Order=False)  # -> simplify(Data); disabled
merge_12 = Merge(Data1=branch, Data2=dup)  # disabled
panel_33 = Panel("{54,55,56...}")  # disabled
panel_34 = Panel("{63,64,65...}")  # disabled
split_4 = SplitTree(Data=merge_12, Masks=flatten(panel_33))  # -> Positive, Negative; disabled
split_5 = SplitTree(Data=split_4.Positive, Masks=flatten(panel_34))  # -> Positive, Negative; disabled
panel_35 = Panel("-2")  # disabled
shift_2 = ShiftList(List=split_5.Positive, Shift=panel_35, Wrap=True)  # disabled
merge_13 = Merge(Data1=simplify(split_5.Negative), Data2=simplify(shift_2))  # disabled
panel_36 = Panel("1")  # disabled
shift_3 = ShiftList(List=merge_13, Shift=panel_36, Wrap=True)  # disabled
merge_14 = Merge(Data1=simplify(split_4.Negative), Data2=simplify(shift_3))  # disabled
flip_8 = FlipMatrix(Data=merge_14)  # disabled
pline_5 = PolyLine(Vertices=flip_8, Closed=False)  # disabled

panel_37 = Panel("2")  # disabled
stack = StackData(Data=merge_14, Stack=panel_37)  # disabled
panel_38 = Panel("1")  # disabled
shift_4 = ShiftList(List=stack, Shift=panel_38, Wrap=True)  # disabled
panel_39 = Panel("2")  # disabled
partition = PartitionList(List=shift_4, Size=panel_39)  # -> simplify(Chunks); disabled
path_mapper = PathMapper(partition, source="{A;B}", target="{B;A}")  # disabled
item_11 = ListItem(List=path_mapper, Index=0, Wrap=True)  # -> Item, Item1; disabled
dist = Distance(PointA=item_11.Item, PointB=item_11.Item1)  # disabled
panel_40 = Panel("9")  # disabled
larger_2 = LargerThan(FirstNumber=dist, SecondNumber=panel_40)  # -> flatten(LargerThan), OrEqualTo; disabled
tstat_2 = TreeStatistics(Tree=path_mapper)  # -> Paths, Length, Count; disabled
cull = CullPattern(List=tstat_2.Paths, CullPattern=larger_2.LargerThan)  # disabled
branch_3 = TreeBranch(Tree=path_mapper, Path=cull, MaintainPaths=True)  # disabled
item_12 = ListItem(List=branch_3, Index=0, Wrap=True)  # -> Item, Item1; disabled
ln_5 = Line(StartPoint=item_12.Item, EndPoint=item_12.Item1)  # disabled
panel_41 = Panel("1")  # disabled
number_slider_18 = Slider(3, range=0..10)  # disabled
trim = TrimTree(Tree=ln_5, Depth=panel_41)  # disabled
divide = DivideCurve(Curve=trim, Count=number_slider_18, Kinks=False)  # -> simplify(Points), Tangents, Parameters; disabled
cull_i_5 = CullIndex(List=divide.Points, Indices=[0, -1], Wrap=True)  # -> simplify(graft(List)); disabled
path_mapper_2 = PathMapper(cull_i_5, source="{A;B;C}", target="{A;C}")  # disabled
pline_6 = PolyLine(Vertices=path_mapper_2, Closed=False)  # disabled
explode_4 = Explode(Curve=pline_6, Recursive=True)  # -> Segments, Vertices; disabled
len = Length(Curve=explode_4.Segments)  # disabled
panel_42 = Panel("7")  # disabled
smaller = SmallerThan(FirstNumber=len, SecondNumber=panel_42)  # -> SmallerThan, OrEqualTo; disabled
dispatch_2 = Dispatch(List=explode_4.Segments, DispatchPattern=smaller.OrEqualTo)  # -> ListA, ListB; disabled
join_2 = JoinCurves(Curves=dispatch_2.ListA, Preserve=False)  # -> simplify(Curves); disabled

panel_43 = Panel("-1")  # disabled
panel_44 = Panel("1")  # disabled
shift_5 = ShiftList(List=disc_9.Points, Shift=panel_43, Wrap=True)  # disabled
shift_6 = ShiftList(List=disc_9.Points, Shift=panel_44, Wrap=True)  # disabled
vec2pt_3 = Vector2Pt(PointA=disc_9.Points, PointB=shift_5, Unitize=False)  # -> Vector, Length; disabled
vec2pt_4 = Vector2Pt(PointA=disc_9.Points, PointB=shift_6, Unitize=False)  # -> Vector, Length; disabled
unit = UnitVector(Vector=vec2pt_4.Vector)  # disabled
unit_2 = UnitVector(Vector=vec2pt_3.Vector)  # disabled
addition_4 = Addition(A=unit_2, B=unit)  # disabled
number_slider_19 = Slider(31, range=0..100)  # disabled
amp = Amplitude(Vector=addition_4, Amplitude=1)  # disabled
line_7 = LineSDL(Start=disc_9.Points, Direction=amp, Length=number_slider_19)  # disabled

path_mapper_3 = PathMapper(ln_5, source="{A;B}", target="{B}")  # disabled
divide_2 = DivideCurve(Curve=path_mapper_3, Count=number_slider_18, Kinks=False)  # -> simplify(Points), Tangents, Parameters; disabled
cull_i_6 = CullIndex(List=divide_2.Tangents, Indices=[0, -1], Wrap=True)  # -> simplify(List); disabled
cull_i_7 = CullIndex(List=divide_2.Points, Indices=[0, -1], Wrap=True)  # -> simplify(List); disabled
Z = UnitZ(Factor=1)  # disabled
panel_45 = Panel("90")  # disabled
number_slider_20 = Slider(31, range=0..100)  # disabled
vrot = Rotate(Vector=cull_i_6, Axis=Z, Angle=degrees(panel_45))  # disabled
line_8 = LineSDL(Start=cull_i_7, Direction=vrot, Length=number_slider_20)  # -> simplify(Line); disabled
trim_2 = TrimTree(Tree=line_8, Depth=1)  # -> simplify(Tree); disabled

crv_12 = Curve(simplify(line_7))  # disabled
crv_13 = Curve(trim_2)  # disabled

# ---- group: 2 / 小柱定位轴线
crv_14 = Curve(crv_13)  # disabled

# ---- group: 2 / 巨柱定位轴线
crv_15 = Curve(crv_12)  # disabled

# ---- group: 5 / 巨柱定位轴线
crv_16 = Curve(crv_12)

# ---- group: 5 / 小柱定位轴线
crv_17 = Curve(crv_14)

# ---- group: 5
crv_18 = Curve(simplify(contour_2))
crv_19 = Curve(crv_6)
merge_15 = Merge(Data1=simplify(crv_18), Data2=simplify(graft(crv_19)), Data3=crv_16, Data4=crv_17, Data5=crv_11)

vec2pt_5 = Vector2Pt(PointA=short.ListA, PointB=simplify(short.ListB), Unitize=False)  # -> unitize(Vector), Length
multiplication_8 = Multiplication(A=vec2pt_5.Vector, B=vec2pt_5.Length)
move_7 = Move(Geometry=merge_15, Motion=simplify(multiplication_8))  # -> Geometry, Transform

# ---- group: 2 / 巨柱
crv_20 = Curve(pline_5)  # disabled

# ---- group: 2 / 小柱
crv_21 = Curve(join_2)  # disabled

# ---- group: 5
crv_22 = Curve(rectangle.Rectangle)
geo = Geometry(pt)
pt_8 = Point(flatten(pt_6))

# ---- group: 5 / 代理几何体
geo_2 = Geometry(crv_22)

# ---- group: 5 / 图块基准点
pt_9 = Point(geo)

# ---- group: 5 (continued)
defblock = DefineBlock(BlockName="tk2333", Geometry=geo_2, BlockOrigin=PlaneXY(0, 0, 0), Overwrite=True)
orient = Orient(Geometry=geo_2, Source=pt_9, Target=pt_8)  # -> Geometry, Transform
placeblock = PlaceBlock(BlockName=defblock, Transform=orient.Transform, Bake=Button())

# ==== cluster 四舍五入
x = ClusterInput()  # 小数点后几位数
A = ClusterInput()
_10º = PowerOf10(Value=x)
multiplication = Multiplication(A=A, B=_10º)
int = Integer(multiplication)
division = Division(A=int, B=_10º)
R = ClusterOutput(division)
